# Grasshopper definition Phi Table.gh (Grasshopper 0.9.76)

num_points = Slider(146, range=0..1000)
cull_points = Slider(62, range=0..200)

# ----
# Assumptions
# 
# Angle Measured : Radians
# Distance : Imperial (Inches)
inner_diameter = Slider(3.2, range=0..10)

diameter = Slider(6, range=0..10)

diameter_offset = Slider(0.28, range=0..1)
lip_offset = Slider(0.125, range=0..1)
phi_dot_radius = Slider(0.05, range=0..1)

# ---- group: Theta
pi = Pi(Factor=1)
multiplication = Multiplication(A=pi, B=2)

# ----
xy = XYPlane(Origin=Point(0, 0, 0))

# ---- group: PHI
phi = GoldenRatio(Factor=1)

# ---- group: Radius
division = Division(A=diameter, B=2)

# ----
neg = Negative(Value=lip_offset)

# ---- group: Radius
division_2 = Division(A=inner_diameter, B=2)

# ----
subtraction = Subtraction(A=num_points, B=cull_points)
subtraction_2 = Subtraction(A=division, B=diameter_offset)

# ---- group: Series Count
series = Series(Start=cull_points, Step=1, Count=subtraction)

# ----
division_3 = Division(A=subtraction_2, B=num_points)
multiplication_2 = Multiplication(A=phi, B=multiplication)
sqrt = SquareRoot(Value=series)
sqrt_2 = SquareRoot(Value=num_points)
multiplication_3 = Multiplication(A=sqrt, B=sqrt_2)
multiplication_4 = Multiplication(A=multiplication_2, B=series)
multiplication_5 = Multiplication(A=division_3, B=multiplication_3)
pt = ConstructPoint(XCoordinate=0, YCoordinate=multiplication_5, ZCoordinate=0)
pt_2 = ConstructPoint(XCoordinate=0, YCoordinate=0, ZCoordinate=0)

# ---- group: PHI Points
rotate = Rotate(Geometry=pt, Angle=multiplication_4, Plane=xy)  # -> Geometry, Transform

# ----
circle = CircleCNR(Center=pt_2, Normal=Vector(0, 0, 1), Radius=division)
circle_2 = CircleCNR(Center=pt_2, Normal=Vector(0, 0, 1), Radius=division_2)
circle_3 = CircleCNR(Center=rotate.Geometry, Normal=Vector(0, 0, 1), Radius=phi_dot_radius)
offset = Offset(Curve=circle_2, Distance=neg, Plane=xy, Corners=1)
offset_2 = Offset(Curve=circle, Distance=neg, Plane=xy, Corners=1)
apron_inner_width = Slider(6, range=0..10)
apron_top_height = Slider(1.1, range=0..3)
apron_overhang_width = Slider(7, range=0..10)
material_thickness = Slider(1.1, range=0..10)
leg_bottom_width = Slider(1, range=0..10)
apron_bottom_height = Slider(1.3, range=0..10)
leg_degree = Slider(15, range=0..30)
leg_top_width = Slider(1.8, range=0..10)
leg_overlap = Slider(1.1, range=0..10)
leg_height = Slider(14, range=0..100)
trig = TriangleTrigonometry(Alpha=degrees(leg_degree), Beta=degrees("90"), RLength=leg_height)  # -> Alpha, Beta, Gamma, PLength, QLength, RLength
xy_2 = XYPlane(Origin=Point(0, 0, 0))
num2dom = Num2Dom(input_number=apron_inner_width)
num2dom_2 = Num2Dom(input_number=apron_overhang_width)
dedomain = DeconstructDomain(Domain=num2dom_2)  # -> Start, End
leg_length = Panel(trig.QLength)
pt_3 = ConstructPoint(XCoordinate=dedomain.Start, YCoordinate=0, ZCoordinate=0)
pt_4 = ConstructPoint(XCoordinate=dedomain.End, YCoordinate=0, ZCoordinate=0)
rectangle = Rectangle(Plane=xy_2, XSize=num2dom, YSize=apron_top_height, Radius=0)  # -> Rectangle, Length
ln = Line(StartPoint=pt_3, EndPoint=pt_4)

division_4 = Division(A=trig.PLength, B=leg_height)
pt_5 = ConstructPoint(XCoordinate=division_4, YCoordinate="-1", ZCoordinate=0)
pt_6 = ConstructPoint(XCoordinate=0, YCoordinate=0, ZCoordinate=0)
vec2pt = Vector2Pt(PointA=pt_6, PointB=pt_5, Unitize=False)  # -> Vector, Length

neg_2 = Negative(Value=apron_bottom_height)
vec0 = Vec0(X=0, Y=neg_2)
neg_3 = Negative(Value=leg_bottom_width)
move = Move(Geometry=pt_4, Motion=vec0)  # -> Geometry, Transform

# ---- group: leg outer line
line = LineSDL(Start=pt_4, Direction=vec2pt.Vector, Length=leg_length)

# ----
vec0_2 = Vec0(X=neg_3, Y=0)
neg_4 = Negative(Value=leg_top_width)
eval = EvaluateCurve(Curve=line, Parameter="1")  # -> Point, Tangent, Angle
vec0_3 = Vec0(X=neg_4, Y=0)
move_2 = Move(Geometry=eval.Point, Motion=vec0_2)  # -> Geometry, Transform
rec_2pt = Rectangle2Pt(Plane=xy_2, PointA=pt_3, PointB=move.Geometry, Radius=0)  # -> Rectangle, Length
move_3 = Move(Geometry=pt_4, Motion=vec0_3)  # -> Geometry, Transform

# ---- group: leg bottom line
ln_2 = Line(StartPoint=eval.Point, EndPoint=move_2.Geometry)

# ----
addition = Addition(A=apron_top_height, B=apron_bottom_height)
total_apron_height = Panel(addition)

# ---- group: leg inner line
ln_3 = Line(StartPoint=move_3.Geometry, EndPoint=move_2.Geometry)

# ----
num2dom_3 = Num2Dom(input_number=material_thickness)

# ---- group: leg top line
ln_4 = Line(StartPoint=move_3.Geometry, EndPoint=pt_4)

# ----
join = JoinCurves(Curves=[line, ln_2, ln_3, ln_4], Preserve=False)
boundary = BoundarySurfaces(Edges=join)

# ==== cluster Num2Dom
input_number = ClusterInput()  # Number
division = Division(A=input_number, B=2)
neg = Negative(Value=division)
dom = ConstructDomain(DomainStart=neg, DomainEnd=division)
domain_d = ClusterOutput(dom)

# ==== cluster Vec0
X = ClusterInput()
Y = ClusterInput()
pt = ConstructPoint(XCoordinate=0, YCoordinate=0, ZCoordinate=0)
pt_2 = ConstructPoint(XCoordinate=X, YCoordinate=Y, ZCoordinate=0)
vec2pt = Vector2Pt(PointA=pt, PointB=pt_2, Unitize=False)  # -> Vector, Length
V = ClusterOutput(vec2pt.Vector)
